vi "Gerador de sinais.gviweb"   [LabVIEW NXG 5.0.0]
panel controls:
  "Amplitude": f64 = 5
  "Tempo": f64 = 1
  "Forma de onda": T1 = "Senoidal"
  "Offset": f64
  "Fase": f64
  "Frequência": f64 = 1
  "Razão cíclica": f64 = 50
panel indicators:
  "URL Image": string
  "Waveform Graph": f64[]
  "String Constant": string
types:
  T1 = enum{"Senoidal", "Triangular", "Quadrada", "Dente de Serra", "Trapezoidal"}
  T2 = cluster{"Sinal": string, "Fase": f64, "Offset": f64, "Tempo": f64, "Amplitude": f64, "Frequência": f64, "Razão cíclica": f64}
uses:
  NI::HTTP::Open HTTP Handle.gvi
  WebApp::Conversor ENUM para ARRAY.gviweb
  NI::HTTP::GET.gvi
  NI::HTTP::Close HTTP Handle.gvi
diagram:
  w1 = "Inicialização"  # States
  w2 = T2 {"Sinal"="", "Fase"=0, "Offset"=0, "Tempo"=1, "Amplitude"=5, "Frequência"=1, "Razão cíclica"=50}
  call "Open HTTP Handle.gvi"() -> (client handle out=w3, error out=w4)
  s1 = w1  # shift register
  s2 = w2  # shift register
  while {
    case (s1) {
      frame "Inicialização", Default {
        w5 = s2
        w6 = "Esperar por evento"
        w7 = w3
        w8 = w4
      }
      frame "Esperar por evento" {
        event {
          on "Amplitude" Value changed; "Fase" Value changed; "Forma de onda" Value changed; "Frequência" Value changed; "Offset" Value changed; "Razão cíclica" Value changed; "Tempo" Value changed {
            call "Conversor ENUM para ARRAY.gviweb"(Forma de onda=$"Forma de onda") -> (Sinal=w9)
            Property Node(instance in=s2, "Tempo"=$Tempo, "Amplitude"=$Amplitude, "Fase"=$Fase, "Offset"=$Offset, "Frequência"=$Frequência, "Razão cíclica"=$"Razão cíclica", "Sinal"=w9) -> (instance out=w5)
            w6 = "Simular onda"
            w7 = w3
            w8 = w4
          }
        }
      }
      frame "Simular onda" {
        Property Node(instance in=s2) -> ("Sinal"=w10, "Tempo"=w11, "Offset"=w12, "Amplitude"=w13, "Fase"=w14, "Frequência"=w15, "Razão cíclica"=w16)
        w17 = "?Sinal=%s&Tempo=%.2f&Offset=%.2f&Amplitude=%.2f&Fase=%.2f&Frequencia=%.2f&RazaoCiclica=%.2f"
        Format Into String(formatString=w17, initString="http://brsaolt-514zhif:9090/Gerador_WebService/MetodoGET", w10, w11, w12, w13, w14, w15, w16) -> w18
        $"String Constant" <- w18
        call "GET.gvi"(client handle=w3, url=w18, error in=w4) -> (client handle out=w7, body=w19, error out=w20)
        Unflatten From Json(JSON string=w19, error in (no error)=w20, type and defaults=cluster{"Y": f64[], "dt": f64} {all zero or empty}) -> (error out=w8, value=w21)
        Property Node(instance in=w21) -> ("Y"=w22)
        $"Waveform Graph" <- w22
        w5 = s2
        w6 = "Esperar por evento"
      }
    }
    Wait(time to wait=50)
    next s1 = w6
    next s2 = w5
    stop if FALSE
  }
  call "Close HTTP Handle.gvi"(client handle=w7, error in=w8)
